# Grasshopper definition Hops.gh (Grasshopper 1.0.7)

curve = GetGeometry(AtLeast=1, AtMost=1, DeleteInput=False, Filter=1074004029)
divisions = GetInteger(AtLeast=1, AtMost=1, Maximum=2147483647, Minimum=-2147483648)
divide = DivideCurve(Curve=curve, Count=divisions, Kinks=False)  # -> Points, Tangents, Parameters
rev = ReverseList(List=divide.Points)
ln = Line(StartPoint=divide.Points, EndPoint=rev)
context_bake = ContextBake(Geometry=ln)
